# Grasshopper definition walking.gh (Grasshopper 1.0.7)
# plug-ins: LunchBoxML

geometry = Geometry(<curve referenced from the Rhino model>)
ghpython_script = GhPythonScript()  # -> out, a
# ---------- ghpython_script: Python ----------
__author__ = "User"
__version__ = "2021.12.14"

import rhinoscriptsyntax as rs
filepath="C:\Users\User\Desktop\github\Grasshopper\Python\Communicate\\togh"
filepath=filepath.replace("\\","/")
print filepath

f = open(filepath.replace("\\","/"), "r")
data=f.read()
f = open(filepath, "w")
f.write("")
f.close()
print(data)

print data==""
# ---------- end ghpython_script ----------
divide_distance = DivideDistance(Curve=geometry, Distance=Slider(2, range=0..10))  # -> Points, Tangents, Parameters
list_item = ListItem(List=divide_distance.Points, Index=0, Wrap=True)
polyline = PolyLine(Vertices=divide_distance.Points, Closed=False)
explode = Explode(Curve=polyline, Recursive=True)  # -> Segments, Vertices
partition_list = PartitionList(List=explode.Segments, Size=Slider(2, range=0..10))
list_item_2 = ListItem(List=partition_list, Index=0, Wrap=True)  # -> Item, Item1
point = Point(<point referenced from the Rhino model>)
point_2 = Point(<point referenced from the Rhino model>)
point_3 = Point(<point referenced from the Rhino model>)
merge = Merge(Data1=list_item_2.Item, Data2=list_item_2.Item1)
list_item_3 = ListItem(List=merge, Index=0, Wrap=True)  # -> Item, Item1
plane_3pt = Plane3Pt(PointA=point, PointB=point_2, PointC=point_3)
curve = Curve(list_item_3.Item)
curve_2 = Curve(list_item_3.Item1)
vector = Vector(list_item_3.Item)
vector_2 = Vector(list_item_3.Item1)
curve_3 = Curve(list_item_3.Item)
geometry_2 = Geometry(<curve referenced from the Rhino model>)
explode_2 = Explode(Curve=geometry_2, Recursive=True)  # -> Segments, Vertices
angle = Angle(VectorA=vector, VectorB=vector_2)  # -> Angle, Reflex
angle_2 = Angle(VectorA=vector_2, VectorB=vector)  # -> Angle, Reflex
list_item_4 = ListItem(List=explode_2.Segments, Index=0, Wrap=True)  # -> Item, Item1
end_points = EndPoints(Curve=list_item_4.Item)  # -> Start, End
panel = Panel(angle.Angle)
panel_2 = Panel(angle_2.Angle)
data = Data(merge)
list_item_5 = ListItem(List=data, Index=0, Wrap=True)  # -> Item, Item1
end_points_2 = EndPoints(Curve=list_item_5.Item)  # -> Start, End
rotate = Rotate(Geometry=end_points_2.End, Angle=1.570796327, Plane=end_points_2.Start)  # -> Geometry, Transform
plane_3pt_2 = Plane3Pt(PointA=end_points_2.Start, PointB=end_points_2.End, PointC=rotate.Geometry)
end_points_3 = EndPoints(Curve=list_item_4.Item1)  # -> Start, End
circle = Circle(Plane=PlaneXY(0, 0, 0), Radius=Slider(0.1, range=0..0.1))
rotate_2 = Rotate(Geometry=end_points.End, Angle=1.570796327, Plane=end_points.Start)  # -> Geometry, Transform
divide_curve = DivideCurve(Curve=circle, Count=Slider(16, range=0..100), Kinks=False)  # -> Points, Tangents, Parameters
explode_3 = Explode(Curve=data, Recursive=True)  # -> Segments, Vertices
vector_2pt = Vector2Pt(PointA=end_points.Start, PointB=end_points.End, Unitize=False)  # -> Vector, Length
plane_3pt_3 = Plane3Pt(PointA=end_points.Start, PointB=end_points.End, PointC=rotate_2.Geometry)
orient = Orient(Geometry=divide_curve.Points, Source=PlaneXY(0, 0, 0), Target=plane_3pt_2)  # -> Geometry, Transform
circle_2 = Circle(Plane=plane_3pt_3, Radius=1)
point_4 = Point(end_points_3.End)
move = Move(Geometry=circle_2, Motion=vector_2pt.Vector)  # -> Geometry, Transform
average = Average(Input=orient.Geometry)
brep = Brep([<brep referenced from the Rhino model> x22])
mesh_join = MeshJoin(Meshes=brep)
list_item_6 = ListItem(List=data, Index=0, Wrap=True)  # -> Item, Item1
curve_4 = Curve(reparameterize(move.Geometry))
curve_closest_point = CurveClosestPoint(Point=point_4, Curve=curve_4)  # -> Point, Parameter, Distance
end_points_4 = EndPoints(Curve=list_item_6.Item)  # -> Start, End
vector_2pt_2 = Vector2Pt(PointA=average, PointB=orient.Geometry, Unitize=False)  # -> Vector, Length
geometry_3 = Geometry(list_item_6.Item)
multiplication = Multiplication(A=curve_closest_point.Parameter, B=Slider(360, range=0..1000))
end_points_5 = EndPoints(Curve=list_item_6.Item1)  # -> Start, End
geometry_4 = Geometry(list_item_4.Item)
geometry_5 = Geometry([<curve referenced from the Rhino model> x2])
rotate_3 = Rotate(Geometry=end_points_4.End, Angle=1.570796327, Plane=end_points_4.Start)  # -> Geometry, Transform
project_point = ProjectPoint(Point=average, Direction=vector_2pt_2.Vector, Geometry=mesh_join)  # -> Point, Index
end_points_6 = EndPoints(Curve=geometry_4)  # -> Start, End
graft_tree = GraftTree(Tree=geometry_5, IncludeEmptyLists=True, IncludeNullItems=True)
list_item_7 = ListItem(List=graft_tree, Index=0, Wrap=True)  # -> Item, Item1
vector_2pt_3 = Vector2Pt(PointA=end_points_4.Start, PointB=end_points_4.End, Unitize=False)  # -> Vector, Length
rotate_4 = Rotate(Geometry=geometry_4, Angle=degrees(multiplication), Plane=end_points_6.Start)  # -> Geometry, Transform
plane_3pt_4 = Plane3Pt(PointA=end_points_4.Start, PointB=end_points_4.End, PointC=rotate_3.Geometry)
end_points_7 = EndPoints(Curve=list_item_7.Item)  # -> Start, End
distance = Distance(PointA=average, PointB=project_point.Point)
circle_3 = Circle(Plane=plane_3pt_4, Radius=1)
point_5 = Point(end_points_5.End)
move_2 = Move(Geometry=circle_3, Motion=vector_2pt_3.Vector)  # -> Geometry, Transform
list_length = ListLength(List=distance)  # -> flatten(Length)
rotate_5 = Rotate(Geometry=end_points_7.End, Angle=1.570796327, Plane=end_points_7.Start)  # -> Geometry, Transform
flatten_tree = FlattenTree(Tree=distance, Path="{0}")
curve_5 = Curve(reparameterize(move_2.Geometry))
curve_closest_point_2 = CurveClosestPoint(Point=point_5, Curve=curve_5)  # -> Point, Parameter, Distance
average_2 = Average(Input=list_length)
plane_3pt_5 = Plane3Pt(PointA=end_points_7.Start, PointB=end_points_7.End, PointC=rotate_5.Geometry)
duplicate_data = DuplicateData(Data=flatten_tree, Number=Slider(10, range=0..10), Order=True)
list_length_2 = ListLength(List=duplicate_data)  # -> flatten(Length)
multiplication_2 = Multiplication(A=curve_closest_point_2.Parameter, B=Slider(360, range=0..1000))
circle_4 = Circle(Plane=PlaneXY(0, 0, 0), Radius=Slider(0.1, range=0..0.1))
flatten_tree_2 = FlattenTree(Tree=curve_closest_point_2.Parameter, Path="{0}")
divide_curve_2 = DivideCurve(Curve=circle_4, Count=Slider(16, range=0..100), Kinks=False)  # -> Points, Tangents, Parameters
panel_3 = Panel(multiplication_2)
random = Random(Range=Domain(0.9, 1.1), Number=list_length_2, Seed=2)
brep_2 = Brep([<brep referenced from the Rhino model> x22])
duplicate_data_2 = DuplicateData(Data=flatten_tree_2, Number=Slider(10, range=0..10), Order=True)
mesh_join_2 = MeshJoin(Meshes=brep_2)
orient_2 = Orient(Geometry=divide_curve_2.Points, Source=PlaneXY(0, 0, 0), Target=plane_3pt_5)  # -> Geometry, Transform
multiplication_3 = Multiplication(A=random, B=duplicate_data)
average_3 = Average(Input=orient_2.Geometry)
partition_list_2 = PartitionList(List=multiplication_3, Size=average_2)
number_slider = Slider(1000, range=0..1000)
load_model = LoadModel()
number_slider_2 = Slider(200, range=0..1000)
number_slider_3 = Slider(10, range=0..10)
list_item_8 = ListItem(List=duplicate_data_2, Index=0, Wrap=True)
panel_4 = Panel(partition_list_2)
graft_tree_2 = GraftTree(Tree=duplicate_data_2, IncludeEmptyLists=True, IncludeNullItems=True)
explode_tree = ExplodeTree(Data=partition_list_2)  # -> Branch0, Branch1
vector_2pt_4 = Vector2Pt(PointA=average_3, PointB=orient_2.Geometry, Unitize=False)  # -> Vector, Length
restricted_boltzmann_machine = RestrictedBoltzmannMachine(Momentum=0, LearningRate=0.1, Decay=0, Alpha=0.5, Iterations=5000, RandomSeed=5)
neural_network_trainer = NeuralNetworkTrainer(
    TrainingInputs=partition_list_2,
    TrainingOutputs=graft_tree_2,
    HiddenNeurons=Slider(10, range=0..100),
    LearningAlgorithm=1,
    ActivationFunction=0,
    Alpha=Slider(0.12, range=0..1),
    Iterations=Slider(500, range=0..10000))  # -> TrainedNueralNetwork, ErrorsDynamics
panel_5 = Panel(graft_tree_2)
project_point_2 = ProjectPoint(Point=average_3, Direction=vector_2pt_4.Vector, Geometry=mesh_join_2)  # -> Point, Index
neural_network_tester = NeuralNetworkTester()
distance_2 = Distance(PointA=average_3, PointB=project_point_2.Point)
data_2 = Data(graft_tree)
panel_6 = Panel(neural_network_trainer.ErrorsDynamics)
end_points_8 = EndPoints(Curve=data_2)  # -> Start, End
file_path = FilePath("C:\Users\User\Desktop\github\Grasshopper\AI\MODEL.bin")
panel_7 = Panel(distance_2)
load_model_2 = LoadModel(FilePath=file_path)
vector_2pt_5 = Vector2Pt(PointA=end_points_8.Start, PointB=end_points_8.End, Unitize=False)  # -> Vector, Length
move_3 = Move(Geometry=data_2, Motion=vector_2pt_5.Vector)  # -> Geometry, Transform
neural_network_tester_2 = NeuralNetworkTester(TrainedNeuralNetwork=load_model_2, TestInputData=panel_7)
multiplication_4 = Multiplication(A=neural_network_tester_2, B=Slider(360, range=0..1000))
panel_8 = Panel(neural_network_tester_2)
rotate_6 = Rotate(Geometry=move_3.Geometry, Angle=degrees(multiplication_4), Plane=end_points_8.End)  # -> Geometry, Transform
