# Grasshopper definition LSTM_TEST.gh (Grasshopper 1.0.7)

geometry = Geometry(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)
timer = Timer(TimerInterval=100, Target=ghpython_script)  # disabled
number_slider = Slider(4798, range=0..11000)
number_slider_2 = Slider(146, range=50..250)
ghpython_script = GhPythonScript()  # -> out, a
# ---------- ghpython_script: Python ----------
__author__ = "User"
__version__ = "2021.01.25"

import rhinoscriptsyntax as rs

try:
    counter-3
except:
    counter=0
counter  += 1

a=counter
# ---------- end ghpython_script ----------
geometry_2 = Geometry([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])
geometry_3 = Geometry([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])
multiplication = Multiplication(A=ghpython_script.a, B=Slider(100, range=0..100))
surface = Surface(geometry_3)
circle = Circle(Plane=PlaneXY(0, 0, 0), Radius=Slider(100, range=0..100))
random = Random(Range=Domain(50, 300), Number=1, Seed=ghpython_script.a)
divide_curve = DivideCurve(Curve=geometry, Count=random, Kinks=False)  # -> Points, Tangents, Parameters
nurbs_curve = NurbsCurve(Vertices=divide_curve.Points, Degree=3, Periodic=True)  # -> Curve, Length, Domain
divide_length = DivideLength(Curve=nurbs_curve.Curve, Length=Slider(1, range=0..10))  # -> Points, Tangents, Parameters
shift_list = ShiftList(List=divide_length.Points, Shift=multiplication, Wrap=True)
panel = Panel(ghpython_script.a)
solid_union = SolidUnion(Breps=surface)
brep_edges = BrepEdges(Brep=solid_union)  # -> Naked, Interior, NonManifold
cluster = Cluster(list=shift_list)  # -> list_a, list_a_2
geometry_4 = Geometry(cluster.list_a)
geometry_5 = Geometry(cluster.list_a_2)
geometry_6 = Geometry(cluster.list_a)
join_curves = JoinCurves(Curves=brep_edges.Naked, Preserve=False)
polyline = PolyLine(Vertices=geometry_4, Closed=False)
polyline_2 = PolyLine(Vertices=geometry_5, Closed=False)
polyline_3 = PolyLine(Vertices=geometry_6, Closed=False)
unit_z = UnitZ(Factor=Slider(100, range=0..100))
extrude = Extrude(Base=join_curves, Direction=unit_z)
end_points = EndPoints(Curve=polyline)  # -> Start, End
end_points_2 = EndPoints(Curve=polyline_2)  # -> Start, End
explode = Explode(Curve=polyline_3, Recursive=True)  # -> Segments, Vertices
explode_2 = Explode(Curve=polyline_3, Recursive=True)  # -> Segments, Vertices
number_slider_3 = Slider(360, range=0..1000)
extrude_2 = Extrude(Base=geometry_2, Direction=unit_z)
geometry_7 = Geometry(<curve referenced from the Rhino model>)
geometry_8 = Geometry(<curve referenced from the Rhino model>)
line = Line(StartPoint=end_points_2.Start, EndPoint=end_points_2.End)
line_2 = Line(StartPoint=end_points.Start, EndPoint=end_points.End)
graft_tree = GraftTree(Tree=explode.Segments, IncludeEmptyLists=True, IncludeNullItems=True)
list_item = ListItem(List=explode_2.Segments, Index=Slider(26, range=0..100), Wrap=True)
list_item_2 = ListItem(List=explode_2.Segments, Index=Slider(27, range=0..100), Wrap=True)
geometry_9 = Geometry(<curve referenced from the Rhino model>)
divide_domain = DivideDomain(Domain=Domain(0, 1), Count=Slider(28, range=0..100))
merge = Merge(Data1=extrude, Data2=extrude_2)
end_points_3 = EndPoints(Curve=graft_tree)  # -> Start, End
geometry_10 = Geometry(<curve referenced from the Rhino model>)
geometry_11 = Geometry(<curve referenced from the Rhino model>)
end_points_4 = EndPoints(Curve=geometry_9)  # -> Start, End
end_points_5 = EndPoints(Curve=line)  # -> Start, End
geometry_12 = Geometry(<curve referenced from the Rhino model>)
end_points_6 = EndPoints(Curve=line_2)  # -> Start, End
angle = Angle(VectorA=list_item, VectorB=list_item_2)  # -> Angle, Reflex
vector = Vector(geometry_10)
vector_2 = Vector(geometry_11)
vector_3 = Vector(geometry_9)
vector_4 = Vector(geometry_12)
deconstruct_domain = DeconstructDomain(Domain=divide_domain)  # -> Start, End
cluster_2 = Cluster_2(geometry=geometry_7, geometry_2=geometry_8)
negative = Negative(Value=Slider(10, range=0..10))
mesh_join = MeshJoin(Meshes=flatten(merge))
angle_2 = Angle(VectorA=vector, VectorB=vector_2)  # -> Angle, Reflex
angle_3 = Angle(VectorA=vector_3, VectorB=vector_4)  # -> Angle, Reflex
rotate = Rotate(Angle=degrees(Slider(10, range=0..10)), Plane=PlaneXY(0, 0, 0))  # -> Geometry, Transform
pipe = Pipe(Curve=list_item, Radius=1, Caps=0)
pipe_2 = Pipe(Curve=list_item_2, Radius=1, Caps=0)
vector_5 = Vector(graft_tree)
line_pt = LinePt(Line=line_2, Point=end_points_5.End)
rotate_2 = Rotate(Angle=degrees(Slider(10, range=0..10)), Plane=PlaneXY(0, 0, 0))  # -> Geometry, Transform
multiplication_2 = Multiplication(A=deconstruct_domain.End, B=Slider(360, range=0..1000))
point = Point(vector_5)
unit_z_2 = UnitZ(Factor=negative)
deconstruct_plane = DeconstructPlane(Plane=line_pt)  # -> Origin, XAxis, YAxis, ZAxis
rotate_3 = Rotate(Geometry=point, Angle=degrees(multiplication_2), Plane=PlaneXY(0, 0, 0))  # -> Geometry, Transform
panel_2 = Panel(angle_3.Reflex)
panel_3 = Panel(deconstruct_plane.ZAxis)
move = Move(Geometry=mesh_join, Motion=unit_z_2)  # -> Geometry, Transform
project_point = ProjectPoint(Point=end_points_3.Start, Direction=rotate_3.Geometry, Geometry=move.Geometry)  # -> Point, Index
data = Data(explode.Segments)
number = Number(cluster_2)
line_3 = Line(StartPoint=end_points_3.Start, EndPoint=project_point.Point)
list_item_3 = ListItem(List=data, Index=Slider(26, range=0..100), Wrap=True)  # -> Item, Item1
group = Group(Objects=line_3)  # -> flatten(Group)
panel_4 = Panel(number)
cluster_3 = Cluster_2(geometry=list_item_3.Item, geometry_2=list_item_3.Item1)
length = Length(Curve=line_3)  # -> flatten(Length)
list_item_4 = ListItem(List=group, Index=Slider(0, range=0..28), Wrap=True)
number_slider_4 = Slider(0, range=0..5000)
flatten_tree = FlattenTree(Tree=cluster_3, Path="{0}")
number_slider_5 = Slider(212, range=100..250)
merge_2 = Merge(Data1=length, Data2=flatten_tree)
panel_5 = Panel(length)
geometry_13 = Geometry([<curve referenced from the Rhino model> x4])
panel_6 = Panel(flatten_tree)
text_join = TextJoin(Text=merge_2, Join=",")
merge_3 = Merge(Data1=",", Data2=text_join)
timer_2 = Timer(TimerInterval=20, Target=ghpython_script_3)
text_join_2 = TextJoin(Text=merge_3)
ghpython_script_2 = GhPythonScript(x=text_join_2)  # -> out, a; disabled
# ---------- ghpython_script_2: Python ----------
print x
f = open(r"C:\Users\User\PycharmProjects\AII\Pytorch\ALADDIN\data_from_gh_lstm_mid.csv", "a")
f.write(str(x))
f.close()
# ---------- end ghpython_script_2 ----------
ghpython_script_3 = GhPythonScript()  # -> out, a; same code as ghpython_script
random_2 = Random(Range=Domain(100, 500), Number=1, Seed=ghpython_script_3.a)
divide_curve_2 = DivideCurve(Curve=geometry_13, Count=random_2, Kinks=False)  # -> Points, Tangents, Parameters
geometry_14 = Geometry(<curve referenced from the Rhino model>)  # disabled
panel_7 = Panel(ghpython_script_3.a)
nurbs_curve_2 = NurbsCurve(Vertices=divide_curve_2.Points, Degree=Slider(2, range=0..10), Periodic=False)  # -> flatten(Curve), Length, Domain
panel_8 = Panel(text_join_2)
geometry_15 = Geometry(geometry_14)  # disabled
graft_tree_2 = GraftTree(Tree=nurbs_curve_2.Curve, IncludeEmptyLists=True, IncludeNullItems=True)
number_slider_6 = Slider(28, range=0..100)  # disabled
divide_length_2 = DivideLength(Curve=graft_tree_2, Length=Slider(10, range=0..10))  # -> Points, Tangents, Parameters
end_points_7 = EndPoints(Curve=geometry_15)  # -> Start, End; disabled
cluster_4 = Cluster_3(vector=geometry_15)  # disabled
shatter = Shatter(Curve=graft_tree_2, Parameters=divide_length_2.Parameters)
series = Series(Start=0, Step=1, Count=number_slider_6)  # disabled
point_2 = Point(end_points_7.Start)  # disabled
stream_gate = StreamGate(Gate=0)  # -> Target0, Target1
number_slider_7 = Slider(0, range=0..100)  # disabled
vector_6 = Vector(cluster_4)  # disabled
number_slider_8 = Slider(1, range=0..1)  # disabled
geometry_16 = Geometry(<curve referenced from the Rhino model>)  # disabled
geometry_17 = Geometry(<curve referenced from the Rhino model>)  # disabled
divide_curve_3 = DivideCurve(Curve=shatter, Count=Slider(2, range=0..10), Kinks=False)  # -> Points, Tangents, Parameters
end_points_8 = EndPoints(Curve=geometry_17)  # -> Start, End; disabled
number_slider_9 = Slider(1, range=0..1)
number_slider_10 = Slider(1, range=0..1)
project_point_2 = ProjectPoint(Point=point_2, Direction=vector_6, Geometry=move.Geometry)  # -> Point, Index; disabled
line_4 = Line(StartPoint=point_2, EndPoint=project_point_2.Point)  # disabled
cluster_5 = Cluster_2(geometry=geometry_17, geometry_2=geometry_16)  # disabled
reverse_list = ReverseList(List=divide_curve_3.Points)
extend_curve = ExtendCurve(Curve=geometry_15, Type=0, Start=number_slider_7, End=number_slider_8)  # disabled
number_slider_11 = Slider(2, range=0..10)
polyline_4 = PolyLine(Vertices=reverse_list, Closed=False)
polyline_5 = PolyLine(Vertices=divide_curve_3.Points, Closed=False)
rotate_4 = Rotate(Geometry=geometry_17, Angle=cluster_5, Plane=end_points_8.Start)  # -> Geometry, Transform; disabled
group_2 = Group(Objects=line_4)  # disabled
end_points_9 = EndPoints(Curve=extend_curve)  # -> Start, End; disabled
list_item_5 = ListItem(List=group_2, Index=series, Wrap=True)  # disabled
merge_4 = Merge(Data1=polyline_4, Data2=polyline_5)  # -> flatten(Result)
line_5 = Line(StartPoint=end_points_7.End, EndPoint=end_points_9.End)  # disabled
vector_2pt = Vector2Pt(PointA=end_points_7.Start, PointB=end_points_7.End, Unitize=False)  # -> Vector, Length; disabled
ungroup = Ungroup(Group=list_item_5)  # -> flatten(Objects); disabled
list_item_6 = ListItem(List=merge_4, Index=ghpython_script_3.a, Wrap=True)
vector_7 = Vector(vector_2pt.Vector)  # disabled
divide_domain_2 = DivideDomain(Domain=Domain(0, 1), Count=Slider(28, range=0..100))
length_2 = Length(Curve=ungroup)  # disabled
control_points = ControlPoints(Curve=list_item_6)  # -> Points, Weights, Knots
move_2 = Move(Geometry=geometry_15, Motion=vector_7)  # -> Geometry, Transform; disabled
explode_3 = Explode(Curve=list_item_6, Recursive=True)  # -> Segments, Vertices
end_points_10 = EndPoints(Curve=line_5)  # -> Start, End; disabled
deconstruct_domain_2 = DeconstructDomain(Domain=divide_domain_2)  # -> Start, End
cluster_6 = Cluster_5(text=length_2)  # disabled
pipe_3 = Pipe(Curve=list_item_6, Radius=Slider(8, range=0..100), Caps=0)
show_output_of_cmd = ShowOutputOfCmd()
end_points_11 = EndPoints(Curve=move_2.Geometry)  # -> Start, End; disabled
ghpython_script_4 = GhPythonScript(x=cluster_6)  # -> out, a; disabled
# ---------- ghpython_script_4: Python ----------
__author__ = "User"
__version__ = "2021.01.25"

import rhinoscriptsyntax as rs
a=float(x)
# ---------- end ghpython_script_4 ----------
point_list = PointList(Points=control_points.Points, Size=Slider(3.853, range=0..10))
multiplication_3 = Multiplication(A=deconstruct_domain_2.End, B=Slider(360, range=0..1000))
rotate_5 = Rotate(Geometry=line_5, Angle=ghpython_script_4.a, Plane=end_points_10.Start)  # -> Geometry, Transform; disabled
list_item_7 = ListItem(List=explode_3.Segments, Index=0, Wrap=True)  # -> Item, Item1
number_2 = Number(ghpython_script_4.a)  # disabled
panel_9 = Panel(cluster_6)  # disabled
rotate_6 = Rotate(Geometry=move_2.Geometry, Angle=ghpython_script_4.a, Plane=end_points_11.Start)  # -> Geometry, Transform; disabled
pi = Pi(Factor=Slider(2, range=0..10))
divide_domain_3 = DivideDomain(Domain=pi, Count=Slider(100, range=0..100))
geometry_18 = Geometry(list_item_7.Item)
control_points_2 = ControlPoints(Curve=geometry_18)  # -> Points, Weights, Knots
vector_8 = Vector(geometry_18)
deconstruct_domain_3 = DeconstructDomain(Domain=divide_domain_3)  # -> Start, End
geometry_19 = Geometry(move.Geometry)
graft_tree_3 = GraftTree(Tree=control_points_2.Points, IncludeEmptyLists=True, IncludeNullItems=True)
number_slider_12 = Slider(1.1, range=0..10)
cluster_7 = Cluster_2(geometry=list_item_7.Item, geometry_2=list_item_7.Item1)
rotate_7 = Rotate(Geometry=vector_8, Angle=deconstruct_domain_3.End, Plane=PlaneXY(0, 0, 0))  # -> Geometry, Transform
project_point_3 = ProjectPoint(Point=graft_tree_3, Direction=rotate_7.Geometry, Geometry=geometry_19)  # -> Point, Index
line_6 = Line(StartPoint=graft_tree_3, EndPoint=project_point_3.Point)
length_3 = Length(Curve=line_6)
merge_5 = Merge(Data1=flatten(length_3), Data2=flatten(cluster_7))
group_3 = Group(Objects=line_6)  # -> flatten(Group)
panel_10 = Panel(merge_5)
panel_11 = Panel(",")
list_item_8 = ListItem(List=group_3, Index=Slider(4, range=0..10), Wrap=True)
text_join_3 = TextJoin(Text=panel_10, Join=",")
merge_6 = Merge(Data1=",", Data2=text_join_3)
text_join_4 = TextJoin(Text=merge_6)
ghpython_script_5 = GhPythonScript(x=text_join_4)  # -> out, a
# ---------- ghpython_script_5: Python ----------
print x
f = open(r"C:\Users\User\PycharmProjects\AII\Pytorch\GH_LSTM\LSTM_TEST_S_2_100_large.csv", "a")
f.write(str(x))
f.close()
# ---------- end ghpython_script_5 ----------
panel_12 = Panel(text_join_4)
data_dam = DataDam(DataDataA=data_dam_2, BufferDelay=2500000, BufferMode=0)
geometry_20 = Geometry(data_dam)
geometry_21 = Geometry(data_dam)
geometry_22 = Geometry(geometry_21)
extend_curve_2 = ExtendCurve(Curve=geometry_22, Type=0, Start=Slider(28, range=0..100), End=Slider(0.3, range=0..1))
end_points_12 = EndPoints(Curve=geometry_22)  # -> Start, End
end_points_13 = EndPoints(Curve=extend_curve_2)  # -> Start, End
divide_curve_4 = DivideCurve(Curve=extend_curve_2, Count=Slider(27, range=0..100), Kinks=False)  # -> reverse(Points), Tangents, Parameters
line_7 = Line(StartPoint=end_points_12.End, EndPoint=end_points_13.End)
graft_tree_4 = GraftTree(Tree=divide_curve_4.Points, IncludeEmptyLists=True, IncludeNullItems=True)
vector_9 = Vector(line_7)
point_3 = Point(vector_9)
rotate_8 = Rotate(Geometry=point_3, Angle=degrees(multiplication_3), Plane=PlaneXY(0, 0, 0))  # -> Geometry, Transform
project_point_4 = ProjectPoint(Point=graft_tree_4, Direction=rotate_8.Geometry, Geometry=move.Geometry)  # -> Point, Index
line_8 = Line(StartPoint=graft_tree_4, EndPoint=project_point_4.Point)  # -> flatten(Line)
length_4 = Length(Curve=line_8)
cluster_8 = Cluster_5(text=length_4)
line_9 = Line(StartPoint=end_points_12.End, EndPoint=end_points_13.End)
ghpython_script_6 = GhPythonScript(x=cluster_8)  # -> out, a; same code as ghpython_script_4
multiplication_4 = Multiplication(A=ghpython_script_6.a, B=Slider(3, range=0..10))
end_points_14 = EndPoints(Curve=line_9)  # -> Start, End
sphere = Sphere(Base=end_points_14.Start, Radius=Slider(5, range=0..100))
data_recorder = DataRecorder(end_points_14.Start, DataLimit=-10, RecordData=True)
addition = Addition(A=multiplication_4, B=Slider(0, range=0..100))
rotate_9 = Rotate(Geometry=line_9, Angle=addition, Plane=end_points_14.Start)  # -> Geometry, Transform
nurbs_curve_3 = NurbsCurve(Vertices=data_recorder, Degree=3, Periodic=False)  # -> Curve, Length, Domain; disabled
data_dam_2 = DataDam(DataA=rotate_9.Geometry, BufferDelay=2500000, BufferMode=2)
panel_13 = Panel(ghpython_script_6.a)

# ==== cluster Cluster
number_slider = Slider(29, range=0..100)
list = ClusterInput()
split_list = SplitList(List=list, Index=number_slider)  # -> ListA, ListB
list_a = ClusterOutput(split_list.ListA)
split_list_2 = SplitList(List=split_list.ListB, Index=number_slider)  # -> ListA, ListB
list_a_2 = ClusterOutput(split_list_2.ListA)

# ==== cluster Cluster_2
geometry = ClusterInput()
geometry_2 = ClusterInput()
geometry_3 = Geometry(geometry)
geometry_4 = Geometry(geometry_2)
end_points = EndPoints(Curve=geometry_4)  # -> Start, End
line_pt = LinePt(Line=geometry_3, Point=end_points.End)
angle = Angle(VectorA=geometry_3, VectorB=geometry_4)  # -> Angle, Reflex
deconstruct_plane = DeconstructPlane(Plane=line_pt)  # -> Origin, XAxis, YAxis, ZAxis
deconstruct_vector = DeconstructVector(Vector=deconstruct_plane.ZAxis)  # -> XComponent, YComponent, ZComponent
multiplication = Multiplication(A=angle.Angle, B=deconstruct_vector.ZComponent)
result = ClusterOutput(multiplication)

# ==== cluster ShowOutputOfCmd: show output of cmd
timer = Timer(TimerInterval=1000, Target=ghpython_script)
ghpython_script = GhPythonScript(x=Slider(7, range=0..10))  # -> out, a
# ---------- ghpython_script: Python ----------
import os
a= os.popen('python c:\Users\User\Desktop\pyprint.py').read()
# ---------- end ghpython_script ----------
panel = Panel(ghpython_script.a)

# ==== cluster Cluster_3
vector = ClusterInput()
divide_domain = DivideDomain(Domain=Domain(0, 1), Count=Slider(28, range=0..100))
deconstruct_domain = DeconstructDomain(Domain=divide_domain)  # -> Start, End
vector_2 = Vector(vector)
point = Point(vector_2)
multiplication = Multiplication(A=deconstruct_domain.End, B=Slider(360, range=0..1000))
rotate = Rotate(Geometry=point, Angle=degrees(multiplication), Plane=PlaneXY(0, 0, 0))  # -> Geometry, Transform
geometry = ClusterOutput(rotate.Geometry)

# ==== cluster Cluster_5
text = ClusterInput()
cluster = Cluster_4(text=text)
panel = Panel(cluster)
panel_2 = Panel("""data=@

import numpy as np
import torch
import torch
import torchvision
import torch.nn as nn  # All neural network modules, nn.Linear, nn.Conv2d, BatchNorm, Loss functions
import torch.optim as optim  # For all Optimization algorithms, SGD, Adam, etc.
data=np.array(data)
data=data.reshape(1,28,28)
#print(data.shape)

def load_checkpoint(checkpoint, model, optimizer):
    #print("=> Loading checkpoint")
    model.load_state_dict(checkpoint['state_dict'])
    optimizer.load_state_dict(checkpoint['optimizer'])

class BRNN(nn.Module):
    def __init__(self, input_size, hidden_size, num_layers, num_classes):
        super(BRNN, self).__init__()
        self.hidden_size = hidden_size
        self.num_layers = num_layers
        self.lstm = nn.LSTM(
            input_size, hidden_size, num_layers, batch_first=True, bidirectional=True
        )
        self.fc = nn.Linear(hidden_size * 2, num_classes)

    def forward(self, x):
        h0 = torch.zeros(self.num_layers * 2, x.size(0), self.hidden_size, dtype=torch.float).to(device)
        c0 = torch.zeros(self.num_layers * 2, x.size(0), self.hidden_size, dtype=torch.float).to(device)
        out, _ = self.lstm(x, (h0, c0))
        out = self.fc(out[:, -1, :])
        return out



input_size = 28
sequence_length = 28
num_layers = 2
hidden_size = 100
num_classes = 1
learning_rate = 0.00001
batch_size = 100
num_epochs = 50
device="cpu"

model = BRNN(input_size, hidden_size, num_layers, num_classes).to(device)
criterion = nn.MSELoss()
optimizer = optim.Adam(model.parameters(), lr=learning_rate)
load_checkpoint(torch.load("c:\my_checkpoint_lstm_gh.pth.tar"), model, optimizer)
#print("data==",data.shape)
data=torch.tensor(data,dtype=torch.float)
#print("model=", model)

print(float(model(data)))""")
replace_text = ReplaceText(Text=panel_2, Find="@", Replace=panel, RecursiveReplace=False)
ghpython_script = GhPythonScript(x=replace_text)  # -> out, a
# ---------- ghpython_script: Python ----------
__author__ = "ckfablab"
__version__ = "2021.01.16"

import rhinoscriptsyntax as rs


f = open(r"C:\gh_gogo.py", "w")
f.write(x)
f.close()


from os import system
import os

import os
a= os.popen("python c:\gh_gogo.py").read()

print a
# ---------- end ghpython_script ----------
a = ClusterOutput(ghpython_script.a)

# ==== cluster Cluster_4
text = ClusterInput()
text_2 = Text(text)
text_join = TextJoin(Text=text_2, Join=",")
replace_text = ReplaceText(Text="[a]", Find="a", Replace=text_join, RecursiveReplace=False)
result = ClusterOutput(replace_text)
