# Grasshopper definition OSMKIT_OpenTopography.gh (Grasshopper 1.0.7)

# https://portal.opentopography.org/API/globaldem?demtype=SRTMGL3&south={s}&north={n}&west={w}&east={e}&outputFormat=AAIGrid
# https://portal.opentopography.org/API/globaldem?demtype=SRTMGL3&south=36.738884&north=36.838884&west=-120.168457&east=-120.068457&outputFormat=AAIGrid
number_slider = Slider(0.01, range=0..0.01)
# https://portal.opentopography.org/apidocs/#/
number_slider_2 = Slider(36.738884, range=0..100)
number_slider_3 = Slider(-120.168457, range=-120.168457..0)
addition = Addition(A=number_slider_2, B=number_slider)
addition_2 = Addition(A=number_slider_3, B=number_slider)
ghpython_script = GhPythonScript(s=number_slider_2, n=addition, w=number_slider_3, e=addition_2)  # -> out, data
# ---------- ghpython_script: Python ----------
import urllib2
text="https://portal.opentopography.org/API/globaldem?demtype=SRTMGL3&south={s}&north={n}&west={w}&east={e}&outputFormat=AAIGrid"


coordinate=[s,n,w,e]
colist=["{s}","{n}","{w}","{e}"]

for i in range(len(colist)):
    if colist[i] in text:
        text=text.replace(colist[i],coordinate[i])

print text
response = urllib2.urlopen(text)

data = response.read()
data = data.split("\n")
# ---------- end ghpython_script ----------
data = Data(["ncols        12", "nrows        12", "xllcorner    -120.168750000014", "yllcorner    36.739583333339", "cellsize     0.000833333333", "NODATA_value 0", " 60 62 62 62 62 61 62 60 62 61 60 60", " 62 62 62 61 61 61 61 60 61 61 62 63", " 62 63 62 62 61 63 61 61 62 60 59 61", " 62 61 61 63 60 60 60 62 61 60 59 59", " 59 60 62 60 59 60 61 61 59 58 59 60", " 61 61 60 61 62 62 62 61 61 61 63 63", " 60 60 61 62 61 61 62 59 60 61 63 63", " 62 61 63 61 63 63 63 60 62 61 63 61", " 63 62 62 62 63 62 62 62 64 62 60 62", " 62 61 62 61 61 61 60 61 61 61 60 60", " 61 61 61 60 61 60 60 61 61 62 61 61", " 60 62 61 62 61 61 59 60 59 58 59 60", ""])
panel = Panel(data)
