# Grasshopper definition DataCommunication.gh (Grasshopper 1.0.7)

number_slider = Slider(250, range=0..1000)
trigger = Trigger(Interval=100, TimerInterval=100, Target=number_slider_3)  # disabled
# def ghdataread():
#     import time
#     time.sleep(0.01)
#     try:
#         f = open("data_from_gh")
#         dataread = f.read().replace("gh:", "")
#         f.close()
#     except:
#         dataread = "Duration"
#     return dataread
# def ghdatawrite(data):
#     import os
#     import time
#     time.sleep(0.01)
#     try:
#         f = open("data_from_py")
#         f.close()
#         data="Duration"
#     except:
#         f = open("data_from_py","w")
#         f.write(data)
#         f.close()
#         try:
#             os.remove("data_from_gh")
#         except:
#             pass
#     return data
number_slider_2 = Slider(15000, range=0..100000)
# import cd
# ghdataread=cd.ghdataread
# ghdatawrite=cd.ghdatawrite
# 
# c=0
# while True:
#     c=c+1
#     print("iteration: "+ str(c))
#     data = ghdataread()
#     if data != "Duration":
#         print(data)
#         #process data here~
#         time.sleep(0.01)# simulate run time
# 
# 
# 
#         # process data here~
#         ghdatawrite(data+str(c))
number_slider_3 = Slider(24, range=0..100)
text = Text(number_slider_3)
duplicate_data = DuplicateData(Data=text, Number=Slider(1000, range=0..1000), Order=True)
text_join = TextJoin(Text=duplicate_data)
file_path = FilePath("C:\Users\User\Desktop\github\Grasshopper\Python\Communicate\DataCommunication\")
trigger_2 = Trigger(Interval=20, TimerInterval=20, Target=ghpython_script)  # disabled
gh2py_communication = Gh2Py_communication(
    input=text_join,
    directory=file_path,
    dc_code="""def ghdataread():
    import time
    time.sleep(0.01)
    try:
        f = open("data_from_gh")
        dataread = f.read().replace("gh:", "")
        f.close()
    except:
        dataread = "Duration"
    return dataread
def ghdatawrite(data):
    import os
    import time
    time.sleep(0.01)
    try:
        f = open("data_from_py")
        f.close()
        data="Duration"
    except:
        f = open("data_from_py","w")
        f.write(data)
        f.close()
        try:
            os.remove("data_from_gh")
        except:
            pass
    return data""",
    example="""import cd
ghdataread=cd.ghdataread
ghdatawrite=cd.ghdatawrite

c=0
while True:
    c=c+1
    print("iteration: "+ str(c))
    data = ghdataread()
    if data != "Duration":
        print(data)
        #process data here~
        time.sleep(0.01)# simulate run time



        # process data here~
        ghdatawrite(data+str(c))""")  # -> out, output, example
# ---------- gh2py_communication: Python ----------
import os
import time
#print directory
path=directory.replace("\\","/")
print path
outputdata=path+"data_from_gh"
print outputdata

inputdata=path+"data_from_py"
print inputdata
dc=path+"cd.py"
examplefile=path+"example.py"

try:
    f=open(outputdata,"r")
    f.close()
except:
    print "outputdata is not existing"
    
    
try:
    open(dc,"r")
    print "dc.py is existing"
except:
    print "dc.py is not existing"
    f=open(dc,"w")
    f.write(dc_code)
    f.close()
    print "dc.py is created"

try:
    open(examplefile,"r")
    print "examplefile is existing"
except:
    print "examplefile is not existing"
    f=open(examplefile,"w")
    f.write(example)
    f.close()
    print "examplefile.py is created"



c=100
while c>0:
    
    c=c-1
    print c
    try:
        f = open(outputdata,"w")
        f.write(input)
        f.close()
        print("file written")
        c=0
    except:
        print(c)

c=100
while c>0:
    time.sleep(0.01)
    c=c-1
    print c
    try:
        f=open(inputdata,"r")
        temp=f.read()
        print(temp[1])
        output=temp
        f.close()
        os.remove(inputdata)
        print("remove inputdata")
        c=0
    except:
        print(c)



print output
# ---------- end gh2py_communication ----------
# Python Repository
# Read Write
file_path_2 = FilePath("C:\Users\User\Desktop\github\Grasshopper\Python\Communicate\mediation")
# Communicating Path
text_length = TextLength(Text=text_join)
ghpython_script = GhPythonScript(x=file_path_2)  # -> out, a
# ---------- ghpython_script: Python ----------
print x

fpath=x.replace("\\","/")
print (fpath)
f = open(fpath, "r")
data=f.read()

print data
gh="saved_by_gh:"

print "current data:" + data

try:
        print data[0]
except:
        data=0


if gh in data:
    print "not yet"
else:
    a=data
    print "gh modifies"
    f = open(fpath, "w")

    ndata=float(data)
    ndata=ndata+1
    ndata=str(ndata)
    f.write(gh+ndata)
    f.close()
    print "modified"
# ---------- end ghpython_script ----------
panel = Panel(gh2py_communication.example)
panel_2 = Panel(ghpython_script.a)
panel_3 = Panel(gh2py_communication.output)
