# Grasshopper definition back_ground_video_generator.gh (Grasshopper 1.0.7)
# plug-ins: Weaverbird, Kangaroo2 Components, GhPolyhedra

quad_sphere = QuadSphere(Plane=PlaneXY(0, 0, 0), Scale=1, Density=0)
icosphere = IcoSphere(Plane=PlaneXY(0, 0, 0), Scale=Slider(0.1, range=0..0.1), Density=0)
weaverbird_s_midedge_subdivision = WeaverbirdsMidedgeSubdivision(MeshCurves=icosphere, Level=1, SmoothNakedEdges=1)
weaverbird_s_constant_quads_split_subdiv = WeaverbirdsConstantQuadsSplitSubdivision(MeshCurves=weaverbird_s_midedge_subdivision, Level=Slider(2, range=0..10), SmoothNakedEdges=1)
weaverbird_s_catmull_clark_subdivision = WeaverbirdsCatmullClarkSubdivision(MeshCurves=weaverbird_s_constant_quads_split_subdiv, Level=1, SmoothNakedEdges=1)
face_boundaries = FaceBoundaries(Mesh=weaverbird_s_catmull_clark_subdivision)
explode = Explode(Curve=face_boundaries, Recursive=True)  # -> flatten(Segments), Vertices
number_slider = Slider(10, range=0..10)
number_slider_2 = Slider(0.77, range=0..1)
number_slider_3 = Slider(1000, range=0..1000)
combine_clean = CombineClean(Meshes=weaverbird_s_catmull_clark_subdivision)
deconstruct_mesh = DeconstructMesh(Mesh=combine_clean)  # -> Vertices, Faces, Colours, Normals
length = Length(Curve=explode.Segments)
number_slider_4 = Slider(101.6, range=0..1000)
number_slider_5 = Slider(94.464, range=0..100)
average = Average(Input=length)
number_slider_6 = Slider(3, range=0..10)
number_slider_7 = Slider(100, range=0..100)
edgelengths = EdgeLengths(Mesh=combine_clean, LengthFactor=Slider(100, range=0..100), Strength=1)
number_slider_8 = Slider(2.564, range=0..10)
show = Show(G=combine_clean)
number_slider_9 = Slider(1.01, range=0..10)
multiplication = Multiplication(A=average, B=Slider(2169, range=0..10000))
spherecollide = SphereCollide(Points=deconstruct_mesh.Vertices, Radius=multiplication, Strength=Slider(0.074, range=0..1))
merge = Merge(Data1=show, Data2=edgelengths, Data3=spherecollide)
colour_swatch = ColourSwatch(SwatchColor=RGB(255, 255, 255))
bouncysolver = BouncySolver(
    GoalObjects=merge,
    Reset=Button(),
    Threshold=1e-15,
    Tolerance=0.0001,
    Damping=Slider(1, range=0..1),
    Iterations=Slider(2, range=0..10),
    On=Toggle(True))  # -> I, V, O
create_material = CreateMaterial(
    Diffuse=ColourSwatch(SwatchColor=RGB(255, 255, 255)),
    Specular=colour_swatch,
    Emission=colour_swatch,
    Transparency=ColourSwatch(SwatchColor=RGB(135, 135, 135)),
    Shine=0)
negative = Negative(Value=Slider(0.8, range=0..10))
list_item = ListItem(List=bouncysolver.O, Index=0, Wrap=True)
weaverbird_s_offset_mesh = WeaverbirdsOffsetMesh(MeshCurves=list_item, Distance=negative, OffsetType=0)
face_boundaries_2 = FaceBoundaries(Mesh=list_item)
control_points = ControlPoints(Curve=face_boundaries_2)  # -> Points, Weights, Knots
custom_preview = CustomPreview(Geometry=weaverbird_s_offset_mesh, Material=create_material)
split_list = SplitList(List=control_points.Points, Index=Slider(1, range=0..1))  # -> ListA, ListB
nurbs_curve = NurbsCurve(Vertices=split_list.ListB, Degree=3, Periodic=Slider(2, range=0..10))  # -> Curve, Length, Domain
custom_preview_2 = CustomPreview(Geometry=nurbs_curve.Curve, Material=ColourSwatch(SwatchColor=RGB(209, 209, 209)))
