# Grasshopper definition nn_walking.gh (Grasshopper 1.0.7)
# plug-ins: LunchBoxML

geometry = Geometry(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)
curve = Curve(<curve referenced from the Rhino model>)
curve_2 = Curve(reparameterize(geometry))
geometry_2 = Geometry([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])
merge = Merge(Data1=curve, Data2=curve_2)
region_union = RegionUnion(Curves=geometry_2)
control_points = ControlPoints(Curve=merge)  # -> flatten(Points), Weights, Knots
unit_z = UnitZ(Factor=Slider(27, range=0..100))
extrude = Extrude(Base=region_union, Direction=unit_z)
nurbs_curve = NurbsCurve(Vertices=control_points.Points, Degree=Slider(2, range=0..10), Periodic=False)  # -> Curve, Length, Domain
divide_curve = DivideCurve(Curve=nurbs_curve.Curve, Count=Slider(800, range=200..1000), Kinks=False)  # -> Points, Tangents, Parameters
negative = Negative(Value=Slider(1.25, range=0..10))
geometry_3 = Geometry(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)
shatter = Shatter(Curve=nurbs_curve.Curve, Parameters=divide_curve.Parameters)
polyline = PolyLine(Vertices=divide_curve.Points, Closed=False)
divide_curve_2 = DivideCurve(Curve=shatter, Count=Slider(2, range=0..10), Kinks=False)  # -> Points, Tangents, Parameters
geometry_4 = Geometry(<curve referenced from the Rhino model>)
polyline_2 = PolyLine(Vertices=divide_curve_2.Points, Closed=False)
circle = Circle(Plane=PlaneXY(0, 0, 0), Radius=1)
divide_curve_3 = DivideCurve(Curve=geometry_4, Count=Slider(2, range=0..10), Kinks=False)  # -> Points, Tangents, Parameters
geometry_5 = Geometry(<point referenced from the Rhino model>)
curve_3 = Curve(reparameterize(circle))
explode = Explode(Curve=polyline_2, Recursive=True)  # -> Segments, Vertices
geometry_6 = Geometry(explode.Segments)
end_points = EndPoints(Curve=circle)  # -> Start, End
end_points_2 = EndPoints(Curve=geometry_6)  # -> Start, End
curve_closest_point = CurveClosestPoint(Point=geometry_5, Curve=curve_3)  # -> Point, Parameter, Distance
polyline_3 = PolyLine(Vertices=divide_curve_3.Points, Closed=False)
pi = Pi(Factor=Slider(2, range=0..10))
rotate = Rotate(Geometry=end_points_2.End, Angle=1.570796327, Plane=end_points_2.Start)  # -> Geometry, Transform
explode_2 = Explode(Curve=polyline_3, Recursive=True)  # -> Segments, Vertices
multiplication = Multiplication(A=curve_closest_point.Parameter, B=pi)
rotate_2 = Rotate(Geometry=end_points.Start, Angle=multiplication, Plane=PlaneXY(0, 0, 0))  # -> Geometry, Transform
line_pt = LinePt(Line=geometry_6, Point=rotate.Geometry)
geometry_7 = Geometry(explode_2.Segments)
geometry_8 = Geometry([<point referenced from the Rhino model>, <curve referenced from the Rhino model> x54])
end_points_3 = EndPoints(Curve=geometry_7)  # -> Start, End
geometry_9 = Geometry([<curve referenced from the Rhino model> x2])
list_item = ListItem(List=line_pt, Index=0, Wrap=True)  # -> Item, Item1
data_input = DataInput(
    Destination="C:\Users\User\Desktop\walk.ghdata",
    RelativePath="C:\Users\User\Desktop\walk.ghdata|walk.ghdata",
    UpdateDelay=50000)
curve_4 = Curve([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])
point = Point(end_points_2.End)
circle_2 = Circle(Plane=list_item.Item, Radius=1)
rotate_3 = Rotate(Geometry=end_points_3.End, Angle=1.570796327, Plane=end_points_3.Start)  # -> Geometry, Transform
stream_gate = StreamGate(Gate=0)  # -> Target0, Target1
mesh = Mesh(extrude)
stream_filter = StreamFilter(Gate=Button(), Stream0=data_input, Stream1=curve_4)
list_item_2 = ListItem(List=reverse(point), Index=0, Wrap=True)
point_2 = Point(circle_2)
curve_5 = Curve(reparameterize(circle_2))
divide_curve_4 = DivideCurve(Curve=circle_2, Count=10, Kinks=False)  # -> Points, Tangents, Parameters
line_pt_2 = LinePt(Line=geometry_7, Point=rotate_3.Geometry)
data = Data(stream_filter)
graft_tree = GraftTree(Tree=data, IncludeEmptyLists=True, IncludeNullItems=True)
curve_closest_point_2 = CurveClosestPoint(Point=list_item_2, Curve=curve_5)  # -> Point, Parameter, Distance
end_points_4 = EndPoints(Curve=data)  # -> Start, End
list_item_3 = ListItem(List=line_pt_2, Index=0, Wrap=True)  # -> Item, Item1
vector_2pt = Vector2Pt(PointA=point_2, PointB=divide_curve_4.Points, Unitize=False)  # -> Vector, Length
pi_2 = Pi(Factor=Slider(2, range=0..10))
circle_3 = Circle(Plane=list_item_3.Item, Radius=1)
cluster = Cluster(geometry=graft_tree)
project_point = ProjectPoint(Point=point_2, Direction=vector_2pt.Vector, Geometry=mesh)  # -> Point, Index
mesh_2 = Mesh(extrude)
circle_4 = Circle(Plane=end_points_4.Start, Radius=1)
multiplication_2 = Multiplication(A=curve_closest_point_2.Parameter, B=pi_2)
unit_z_2 = UnitZ(Factor=Slider(5.2, range=0..10))
distance = Distance(PointA=point_2, PointB=project_point.Point)
extrude_2 = Extrude(Base=circle_4, Direction=unit_z_2)
mesh_3 = Mesh(extrude_2)
merge_2 = Merge(Data1=mesh_2, Data2=mesh_3)  # -> flatten(Result)
mesh_join = MeshJoin(Meshes=merge_2)
addition = Addition(A=distance, B=Slider(0, range=0..100))
data_2 = Data(addition)
bounds = Bounds(Numbers=data_2)
cluster_2 = Cluster_3(plane=cluster, geometry=mesh_join)
panel = Panel(multiplication_2)
cube_root = CubeRoot(Value=data_2)  # -> simplify(Result)
simplify_tree = SimplifyTree(Tree=curve_closest_point_2.Parameter, Front=False)
remap_numbers = RemapNumbers(Value=data_2, Source=bounds, Target=Domain(0, 1))  # -> simplify(Mapped), Clipped
file_path = FilePath("C:\Users\User\Desktop\WALKING.bin")
division = Division()
cluster_3 = Cluster_2(data=cluster_2)
load_model = LoadModel(FilePath=file_path)
merge_3 = Merge(Data1=simplify_tree, Data2=remap_numbers.Mapped)
data_3 = Data(graft_tree)
data_4 = Data(cluster_3)
panel_2 = Panel(cube_root)
offset_curve = OffsetCurve(Curve=region_union, Distance=negative, Corners=1)
move = Move(Geometry=data_3, Motion=data_3)  # -> Geometry, Transform
end_points_5 = EndPoints(Curve=data_3)  # -> Start, End
text_join = TextJoin(Text=merge_3, Join=",")
text_join_2 = TextJoin(Text=merge_3, Join=",")  # -> flatten(Result)
data_recorder = DataRecorder(text_join_2, DataLimit=-10, RecordData=True)
neural_network_tester = NeuralNetworkTester(TrainedNeuralNetwork=load_model, TestInputData=data_4)
panel_3 = Panel(data_4)
text_split = TextSplit(Text=text_join, Separators=",")
fillet = Fillet(Curve=offset_curve, Radius=Slider(1, range=0..1))
pi_3 = Pi(Factor=Slider(2, range=0..10))
split_list = SplitList(List=text_split, Index=Slider(1, range=0..1))  # -> ListA, ListB
multiplication_3 = Multiplication(A=neural_network_tester, B=pi_3)
number_slider = Slider(25, range=0..100)
mesh_4 = Mesh(fillet)
panel_4 = Panel(neural_network_tester)
rotate_4 = Rotate(Geometry=data_3, Angle=multiplication_3, Plane=end_points_5.Start)  # -> Geometry, Transform
panel_5 = Panel(split_list.ListB)
neural_network_tester_2 = NeuralNetworkTester()
neural_network_trainer = NeuralNetworkTrainer(
    TrainingInputs=split_list.ListB,
    TrainingOutputs=split_list.ListA,
    HiddenNeurons=Slider(27, range=0..100),
    LearningAlgorithm=1,
    ActivationFunction=0,
    Alpha=2,
    Iterations=Slider(1500, range=0..10000))  # -> TrainedNueralNetwork, ErrorsDynamics
move_2 = Move(Geometry=rotate_4.Geometry, Motion=rotate_4.Geometry)  # -> flatten(Geometry), Transform
end_points_6 = EndPoints(Curve=move_2.Geometry)  # -> Start, End
mesh_closest_point = MeshClosestPoint(Point=end_points_6.End, Mesh=mesh_4)  # -> Point, Index, Parameter
panel_6 = Panel(neural_network_trainer.ErrorsDynamics)
graft_tree_2 = GraftTree(Tree=mesh_closest_point.Point, IncludeEmptyLists=True, IncludeNullItems=True)
line = Line(StartPoint=end_points_6.Start, EndPoint=mesh_closest_point.Point)
unit_vector = UnitVector(Vector=line)
end_points_7 = EndPoints(Curve=line)  # -> Start, End
move_3 = Move(Geometry=end_points_7.Start, Motion=unit_vector)  # -> Geometry, Transform
line_2 = Line(StartPoint=end_points_7.Start, EndPoint=move_3.Geometry)
data_dam = DataDam(DataA=line_2, BufferDelay=2500000, BufferMode=2)
data_recorder_2 = DataRecorder(graft_tree_2, DataLimit=25, RecordData=False)
data_dam_2 = DataDam(DataDataA=data_dam, BufferDelay=2500000, BufferMode=2)  # -> flatten(DataDataA)
end_points_8 = EndPoints()  # -> Start, End
data_output = DataOutput(
    DataInput=line_2,
    Destination="C:\Users\User\Desktop\walk.ghdata",
    RelativePath="C:\Users\User\Desktop\walk.ghdata|walk.ghdata")
data_dam_3 = DataDam(BufferDelay=2500000, BufferMode=2)

# ==== cluster Cluster
geometry = ClusterInput()
geometry_2 = Geometry(geometry)
end_points = EndPoints(Curve=geometry_2)  # -> Start, End
rotate = Rotate(Geometry=end_points.End, Angle=1.570796327, Plane=end_points.Start)  # -> Geometry, Transform
line_pt = LinePt(Line=geometry_2, Point=rotate.Geometry)
plane = ClusterOutput(line_pt)

# ==== cluster Cluster_2
data = ClusterInput()
data_2 = Data(data)
bounds = Bounds(Numbers=data_2)
remap_numbers = RemapNumbers(Value=data_2, Source=bounds, Target=Domain(0, 1))  # -> simplify(Mapped), Clipped
addition = Addition(A=remap_numbers.Mapped, B=Slider(0, range=0..100))
result = ClusterOutput(addition)

# ==== cluster Cluster_3
plane = ClusterInput()
circle = Circle(Plane=plane, Radius=1)
divide_curve = DivideCurve(Curve=circle, Count=10, Kinks=False)  # -> Points, Tangents, Parameters
point = Point(circle)
vector_2pt = Vector2Pt(PointA=point, PointB=divide_curve.Points, Unitize=False)  # -> Vector, Length
geometry = ClusterInput()
project_point = ProjectPoint(Point=point, Direction=vector_2pt.Vector, Geometry=geometry)  # -> Point, Index
distance = Distance(PointA=point, PointB=project_point.Point)
addition = Addition(A=distance, B=Slider(0, range=0..100))
mass_addition = MassAddition(Input=addition)  # -> Result, PartialResults
multiplication = Multiplication(A=mass_addition.Result, B=Slider(7777, range=0..10000))
list_length = ListLength(List=addition)
random = Random(Range=Domain(0.9, 1.1), Number=list_length, Seed=multiplication)
multiplication_2 = Multiplication(A=addition, B=random)
result = ClusterOutput(multiplication_2)
