# Grasshopper definition pyCounter.gh (Grasshopper 1.0.7)

trigger = Trigger(Interval=10, TimerInterval=10, Target=ghpython_script)
ghpython_script = GhPythonScript(reset=Toggle(True))  # -> out, a
# ---------- ghpython_script: Python ----------
try: 
 print counter 
except: 
 counter=0


if reset:
    counter=counter+1
else:
    counter=0
a=counter
# ---------- end ghpython_script ----------
panel = Panel(ghpython_script.a)
