# Grasshopper definition pyDataReceiver.gh (Grasshopper 1.0.7)

# simulating data input
# the data could be from serial port or UDP TCP, etc.
boolean_toggle = BooleanToggle(True)
trigger = Trigger(Interval=10, TimerInterval=10, Target=pycounter)
pycounter = PyCounter(reset=boolean_toggle)  # -> out, a
# ---------- pycounter: Python ----------
__author__ = "User"
__version__ = "2021.12.10"

import rhinoscriptsyntax as rs

try: 
 print counter 
except: 
 counter=0


if reset:
    counter=counter+1
else:
    counter=0

a=counter
# ---------- end pycounter ----------
panel = Panel("""A;5;6;7
B;3;2;1
C;1;1;1
D;7;7;7""")
list_item = ListItem(List=panel, Index=pycounter.a, Wrap=True)
panel_2 = Panel(list_item)
# Data Receiver
# In the program, it can record the lastest data instead of accumulates all data.
# Additionally, a function to recognize existing name is built in it.
ghpython_script = GhPythonScript(x=list_item, reset=Button())  # -> out, namelist, data
# ---------- ghpython_script: Python ----------
import copy

try:
    print namelist_py[0]
    print data_py[0]
except:
    namelist_py=[]
    data_py=[]

if x.split(";")[0] in namelist_py:
    print("it's existing")
else:
    namelist_py.append(x.split(";")[0])
    data_py=copy.deepcopy(namelist_py)

for i in range(len(data_py)):
    if namelist_py[i] in x:
        data_py[i]=x


if reset:
    namelist_py=[]
    data_py=[]


namelist=namelist_py
data=data_py
# ---------- end ghpython_script ----------
panel_3 = Panel(ghpython_script.namelist)
panel_4 = Panel(ghpython_script.data)
